# Grasshopper definition GeoMining_components.gh (Grasshopper 1.0.8)
# plug-ins: RhinoCodePluginGH

# ----
# Authenticate Machine
your_project_id = Panel("ee-neriiacopo-geomining")
# replace with your project-id to authenticate
py3 = Python3Script(project_id=your_project_id)  # -> out
# ---------- py3: Python ----------
# Check installed plugins ######################################
# requirements: numpy, pyproj, earthengine-api

import subprocess
import sys
import os

import ee
import locale

# Set the locale manually
locale.setlocale(locale.LC_ALL, 'en_US.UTF-8')

# Open Terminal for Authentication process within Rhino
def authenticate_machine():
    # Construct the path to python.exe within the current environment
    py_exe = os.path.join(sys.prefix, "python.exe")
    
    install_ee = f"{py_exe} -m pip install earthengine-api" # Check if ee is installed in root
    command = "import ee; ee.Authenticate(auth_mode='notebook')" # Open UI for authentication

    subprocess.run(["start", "cmd", "/c", install_ee], shell=True)
    subprocess.run(["start", "cmd", "/c", py_exe, "-c", command], shell=True)

# Initialize project
try:
    ee.Initialize(project=project_id)
    out = "Successfully authenticated"
except Exception as e:    
    try:
        authenticate_machine()
        ee.Initialize(project=project_id)
        out = "Successfully authenticated"
    except Exception as e:
        out = "Failed to Authenticate"
# ---------- end py3 ----------
panel = Panel(py3)

crv = Curve(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)
crv_2 = Curve(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)
crv_3 = Curve(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)
crv_4 = Curve(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)
panel_2 = Panel("""2017-06-01
2017-08-31""")
# check the data to find best
# resampling mode:
# - categorical (mode)
# - linear (mean)
# - ...
panel_3 = Panel("COPERNICUS/CORINE/V20/100m/2012")
disc = Discontinuity(Curve=crv_2, Level=1)  # -> flatten(Points), Parameters
# remove dates to run musaic()
panel_4 = Panel("IDAHO_EPSCOR/TERRACLIMATE")
disc_2 = Discontinuity(Curve=crv_3, Level=1)  # -> flatten(Points), Parameters
disc_3 = Discontinuity(Curve=crv, Level=1)  # -> Points, Parameters
# eeFlterDates
filterdates = Python3Script(layer="MODIS/061/MOD11A1", dates=panel_2)  # -> layers, days; inputs layer: String, dates: list
# ---------- filterdates: Python ----------
# Check installed plugins ######################################
# requirements: numpy, pyproj, earthengine-api

import numpy as np
import ee
import os
import rhinoscriptsyntax as rs
from pyproj import CRS
from pyproj.aoi import AreaOfInterest
from pyproj.database import query_utm_crs_info
from pyproj import Transformer

import locale

# Set the locale manually
locale.setlocale(locale.LC_ALL, 'en_US.UTF-8')


def castToFloat(o):
    list = []
    for i in o:
        list.append(float(i))

    return list

def pts_bbox(pts):
    pts_py = []

    for p in pts:
        pts_py.append([p.X, p.Y])

    aoi = ee.Geometry.Polygon(
        [[[pts_py[0][0], pts_py[0][1]],
        [pts_py[1][0], pts_py[1][1]],
        [pts_py[2][0], pts_py[2][1]],
        [pts_py[3][0], pts_py[3][1]]]], None, False)

    return aoi;

def pts_polygon(pts):

    coords = []
    for p in pts:

        coord = [p.X,p.Y]
        coords.append(coord)

    geom_polygon = ee.Geometry.Polygon([ee.Geometry.LinearRing(coords)])

    return geom_polygon

def pts_multipts(pts):

    coords = []
    for p in pts:

        coord = [p.X,p.Y]
        coords.append(coord)

    geom_pts = ee.Geometry.MultiPoint(coords)

    return geom_pts

def img_scaleTrim(image, band, mode, proj, scale, pts):

    # Create reducer for sampling mode
    reducer = "ee.Reducer."+ mode +"()"

    # Resample the image to assign custom scale
    imageResampled = image \
        .reduceResolution(reducer= eval(reducer), maxPixels = 5000) \
        .reproject(crs='EPSG:4326', scale=scale)

    # Extract the bounding region from the locations
    aoi = pts_bbox(pts)

    # Sample the image within the region
    rec_sample = imageResampled.sampleRectangle(region=aoi, defaultValue=0)

    # Prepare the outputs
    np_values = np.array(rec_sample.get(band).getInfo())
    values = np_values.flatten().tolist()

    # Change from pixel to node (vertices)
    H = np_values.shape[0] -1
    W = np_values.shape[1] -1

    return values,W,H;


def ee_filterDate(layer,dates):

    # Filter image collection
    images = ee.ImageCollection(layer) \
             .filter(ee.Filter.date(dates[0],dates[1]))

    # Get metadata
    meta = images.getInfo()
    length = len(meta["features"])
    layers = []
    days = []

    for i in range(length):
        layer = meta["features"][i]["id"]
        day = meta["features"][i]["properties"]["system:index"]
        layers.append(layer)
        days.append(day)

    return (layers, days);

# Run command if inputs are provided
if (layer != None and dates!= None) :
    layers, days = ee_filterDate(layer,dates)
# ---------- end filterdates ----------
# eeImageCollection
panel_5 = Panel("""2017-06-01
2017-09-01""")

fragment = TextFragment(Text=filterdates.days, Start=Slider(0, range=0..10), Count=Slider(7, range=0..10))
cset = CreateSet(List=fragment)  # -> Set, Map
mindex = MemberIndex(Set=fragment, Member=cset.Set)  # -> Index, Count

# ----
# eeImage
eeimage = Python3Script(layer=panel_3, bands="landcover", mode="mode", scale=Slider(100, range=0..1000), pts=disc_3.Points)  # -> values, W, H; inputs layer: String, bands: String, mode: String, scale: Int32, pts: list of Point3d
#   port mode: mean, mode, max, min, sum ...
# ---------- eeimage: Python ----------
# Check installed plugins ######################################
# requirements: numpy, pyproj, earthengine-api

import numpy as np
import ee
import os
import rhinoscriptsyntax as rs
from pyproj import CRS
from pyproj.aoi import AreaOfInterest
from pyproj.database import query_utm_crs_info
from pyproj import Transformer


def castToFloat(o):
    list = []
    for i in o:
        list.append(float(i))

    return list

def pts_bbox(pts):
    pts_py = []

    for p in pts:
        pts_py.append([p.X, p.Y])

    aoi = ee.Geometry.Polygon(
        [[[pts_py[0][0], pts_py[0][1]],
        [pts_py[1][0], pts_py[1][1]],
        [pts_py[2][0], pts_py[2][1]],
        [pts_py[3][0], pts_py[3][1]]]], None, False)

    return aoi;

def pts_polygon(pts):

    coords = []
    for p in pts:

        coord = [p.X,p.Y]
        coords.append(coord)

    geom_polygon = ee.Geometry.Polygon([ee.Geometry.LinearRing(coords)])

    return geom_polygon

def pts_multipts(pts):

    coords = []
    for p in pts:

        coord = [p.X,p.Y]
        coords.append(coord)

    geom_pts = ee.Geometry.MultiPoint(coords)

    return geom_pts

def img_scaleTrim(image, band, mode, proj, scale, pts):

    # Create reducer for sampling mode
    reducer = "ee.Reducer."+ mode +"()"

    # Resample the image to assign custom scale
    imageResampled = image \
        .reduceResolution(reducer= eval(reducer), maxPixels = 5000) \
        .reproject(crs='EPSG:4326', scale=scale)

    # Extract the bounding region from the locations
    aoi = pts_bbox(pts)

    # Sample the image within the region
    rec_sample = imageResampled.sampleRectangle(region=aoi, defaultValue=0)

    # Prepare the outputs
    np_values = np.array(rec_sample.get(band).getInfo())
    values = np_values.flatten().tolist()

    # Change from pixel to node (vertices)
    H = np_values.shape[0] -1
    W = np_values.shape[1] -1

    return values,W,H;


def ee_image(layer,bands,mode,scale,pts):

    # Select image layer
    image = ee.Image(layer)\
        .select(bands)

    # Extract original projection
    proj = image.projection()

    return img_scaleTrim(image, bands, mode, proj, scale, pts);

# Run command if inputs are provided
if (layer != None and bands != None and scale != None and pts != None) :
    if mode == None : mode = "mean"
    values, W, H = ee_image(layer,bands,mode,scale,pts)
# ---------- end eeimage ----------

py3_2 = Python3Script(pts=disc_3.Points, xyz=Toggle(True))  # -> proj; inputs pts: list of Point3d, xyz: Boolean
# ---------- py3_2: Python ----------
# Check installed plugins ######################################
# requirements: numpy, pyproj, earthengine-api

import numpy as np
import ee
import os
import rhinoscriptsyntax as rs
import Rhino.Geometry as rg

from pyproj import CRS
from pyproj.aoi import AreaOfInterest
from pyproj.database import query_utm_crs_info
from pyproj import Transformer




def reproject_UTM(pts, xyz):
    # Compute the centroid location
    xs = []
    ys = []

    for p in pts:
        xs.append(p.X)
        ys.append(p.Y)

    p_mean = [np.asarray(xs).mean(),np.asarray(ys).mean()]

    # Extract UTM of the centroid location
    utm_crs_list = query_utm_crs_info(
        datum_name="WGS 84",
        area_of_interest=AreaOfInterest(
            south_lat_degree=p_mean[1],
            west_lon_degree=p_mean[0],
            north_lat_degree=p_mean[1],
            east_lon_degree=p_mean[0]
        ),
    )

    # Project from 4326 to local UTM
    WSG84_crs = CRS.from_epsg(4326)
    utm_crs = CRS.from_epsg(utm_crs_list[0].code)
    transformer = Transformer.from_crs(WSG84_crs, utm_crs, always_xy=True)

    pts_UTM = []

    p_leftbottom = transformer.transform(pts[0].X,pts[0].Y)

    for p in pts:

        # provide first X then Y -- Lon then Lat
        p_UTM = transformer.transform(p.X,p.Y)

        # Move to origin using left bottom corner
        if xyz == True:
            p_UTM = [p_UTM[0] - p_leftbottom[0], p_UTM[1] - p_leftbottom[1]]

        pts_UTM.append(rs.AddPoint(p_UTM[0], p_UTM[1], 0))

    print(pts_UTM)
    return pts_UTM

proj = reproject_UTM(pts, xyz)
# ---------- end py3_2 ----------
pline = PolyLine(Vertices=reverse(py3_2), Closed=invert(False))
mplane = MeshPlane(Boundary=pline, WidthCount=eeimage.W, HeightCount=eeimage.H)  # -> Mesh, Area

# ----
# eeND
eend = Python3Script(layer="LANDSAT/LE7_TOA_5YEAR/1999_2003", band1="B4", band2="B3", scale=Slider(100, range=0..1000), pts=disc.Points)  # -> values, W, H; inputs layer: String, band1: String, mode: String, scale: Int32, pts: list of Point3d
#   port mode: mean, mode, max, min, sum ...
# ---------- eend: Python ----------
# Check installed plugins ######################################
# requirements: numpy, pyproj, earthengine-api

import numpy as np
import ee
import os
import rhinoscriptsyntax as rs
from pyproj import CRS
from pyproj.aoi import AreaOfInterest
from pyproj.database import query_utm_crs_info
from pyproj import Transformer


def castToFloat(o):
    list = []
    for i in o:
        list.append(float(i))

    return list

def pts_bbox(pts):
    pts_py = []

    for p in pts:
        pts_py.append([p.X, p.Y])

    aoi = ee.Geometry.Polygon(
        [[[pts_py[0][0], pts_py[0][1]],
        [pts_py[1][0], pts_py[1][1]],
        [pts_py[2][0], pts_py[2][1]],
        [pts_py[3][0], pts_py[3][1]]]], None, False)

    return aoi;

def pts_polygon(pts):

    coords = []
    for p in pts:

        coord = [p.X,p.Y]
        coords.append(coord)

    geom_polygon = ee.Geometry.Polygon([ee.Geometry.LinearRing(coords)])

    return geom_polygon

def pts_multipts(pts):

    coords = []
    for p in pts:

        coord = [p.X,p.Y]
        coords.append(coord)

    geom_pts = ee.Geometry.MultiPoint(coords)

    return geom_pts

def img_scaleTrim(image, band, mode, proj, scale, pts):

    # Create reducer for sampling mode
    reducer = "ee.Reducer."+ mode +"()"

    # Resample the image to assign custom scale
    imageResampled = image \
        .reduceResolution(reducer= eval(reducer), maxPixels = 5000) \
        .reproject(crs='EPSG:4326', scale=scale)

    # Extract the bounding region from the locations
    aoi = pts_bbox(pts)

    # Sample the image within the region
    rec_sample = imageResampled.sampleRectangle(region=aoi, defaultValue=0)

    # Prepare the outputs
    np_values = np.array(rec_sample.get(band).getInfo())
    values = np_values.flatten().tolist()

    # Change from pixel to node (vertices)
    H = np_values.shape[0] -1
    W = np_values.shape[1] -1

    return values,W,H;


def ee_ND(layer,band1,band2,mode,scale,pts):

    # Select the two bands to subtract
    image1 = ee.Image(layer).select(band1)
    image2 = ee.Image(layer).select(band2)

    # Compute Normalized Difference
    imageND = image1.subtract(image2) \
              .divide(image1.add(image2)) \
              .rename("ND")

    # Extract original projection
    proj = image1.projection()

    return img_scaleTrim(imageND, "ND", mode, proj, scale, pts);

# Run command if inputs are provided
if (layer != None and band1 != None and band2!= None and scale != None and pts != None) :
    if mode == None : mode = "mean"
    values, W, H = ee_ND(layer,band1,band2,mode,scale,pts)
# ---------- end eend ----------

py3_3 = Python3Script(pts=disc.Points, xyz=Toggle(True))  # -> proj; inputs pts: list of Point3d, xyz: Boolean; same code as py3_2
pline_2 = PolyLine(Vertices=reverse(py3_3), Closed=invert(False))
mplane_2 = MeshPlane(Boundary=pline_2, WidthCount=eend.W, HeightCount=eend.H)  # -> Mesh, Area

imagecollection = Python3Script(layer=panel_4, bands="pdsi", dates=panel_5, scale=Slider(3000, range=0..10000), pts=disc_2.Points)  # -> values, W, H; inputs layer: String, bands: String, dates: list, mode: String, scale: Int32, pts: list of Point3d
# ---------- imagecollection: Python ----------
# Check installed plugins ######################################
# requirements: numpy, pyproj, earthengine-api

import numpy as np
import ee
import os
import rhinoscriptsyntax as rs
from pyproj import CRS
from pyproj.aoi import AreaOfInterest
from pyproj.database import query_utm_crs_info
from pyproj import Transformer

import locale

# Set the locale manually
locale.setlocale(locale.LC_ALL, 'en_US.UTF-8')


def castToFloat(o):
    list = []
    for i in o:
        list.append(float(i))

    return list

def pts_bbox(pts):
    pts_py = []

    for p in pts:
        pts_py.append([p.X, p.Y])

    aoi = ee.Geometry.Polygon(
        [[[pts_py[0][0], pts_py[0][1]],
        [pts_py[1][0], pts_py[1][1]],
        [pts_py[2][0], pts_py[2][1]],
        [pts_py[3][0], pts_py[3][1]]]], None, False)

    return aoi;

def pts_polygon(pts):

    coords = []
    for p in pts:

        coord = [p.X,p.Y]
        coords.append(coord)

    geom_polygon = ee.Geometry.Polygon([ee.Geometry.LinearRing(coords)])

    return geom_polygon

def pts_multipts(pts):

    coords = []
    for p in pts:

        coord = [p.X,p.Y]
        coords.append(coord)

    geom_pts = ee.Geometry.MultiPoint(coords)

    return geom_pts

def img_scaleTrim(image, band, mode, proj, scale, pts):

    # Create reducer for sampling mode
    reducer = "ee.Reducer."+ mode +"()"

    # Resample the image to assign custom scale
    imageResampled = image \
        .reduceResolution(reducer= eval(reducer), maxPixels = 5000) \
        .reproject(crs='EPSG:4326', scale=scale)

    # Extract the bounding region from the locations
    aoi = pts_bbox(pts)

    # Sample the image within the region
    rec_sample = imageResampled.sampleRectangle(region=aoi, defaultValue=0)

    # Prepare the outputs
    np_values = np.array(rec_sample.get(band).getInfo())
    values = np_values.flatten().tolist()

    # Change from pixel to node (vertices)
    H = np_values.shape[0] -1
    W = np_values.shape[1] -1

    return values,W,H;


def ee_imageCollection(layer,bands,dates,mode,scale,pts):

    if dates == None:
        # Make mosaic is no dates is given
        imageColl = ee.ImageCollection(layer)\
            .select(bands)
        
        # Extract original projection
        proj = imageColl.first().projection()

        image = imageColl.mosaic()

    else:
        # Filter by date
        imageColl = ee.ImageCollection(layer)\
            .filter(ee.Filter.date(dates[0], dates[1]))\
            .select(bands)

        image = eval("imageColl." + mode + "()")

         # Extract original projection
        proj = imageColl.first().projection()


    image = image.setDefaultProjection(proj)

    return img_scaleTrim(image, bands, mode, proj, scale, pts);

# Run command if inputs are provided
if (layer != None and bands != None and scale != None and pts != None) :
    if mode == None : mode = "mean"
    values, W, H = ee_imageCollection(layer,bands,dates,mode,scale,pts)
# ---------- end imagecollection ----------

py3_4 = Python3Script(pts=disc_2.Points, xyz=Toggle(True))  # -> proj; inputs pts: list of Point3d, xyz: Boolean; same code as py3_2
pline_3 = PolyLine(Vertices=reverse(py3_4), Closed=invert(False))
mplane_3 = MeshPlane(Boundary=pline_3, WidthCount=imagecollection.W, HeightCount=10)  # -> Mesh, Area

cset_2 = CreateSet(List=eeimage.values)  # -> Set, Map
lng = ListLength(List=cset_2.Set)
wheel = ColourWheel(
    lng,
    ColourGrips_Style=31,
    ColourGrips_Grip=[2.166918358, 4.26131346, 0.07252325533, 5.308511011],
    ColourGrips_Lum=[0.5783285674, 0.8521423836],
    ColourGrips_Range=[1.093574825, 1.093574825, 1.093574825, 1.093574825],
    ColourGrips_Sat=[0.8135900738, 1])
item = ListItem(List=wheel, Index=cset_2.Map, Wrap=True)

bnd = Bounds(Numbers=imagecollection.values)
dedomain = DeconstructDomain(Domain=bnd)  # -> Start, End
gradient = Gradient(
    LowerLimit=dedomain.Start,
    UpperLimit=dedomain.End,
    Parameter=imagecollection.values,
    stops=[0: RGB(255, 0, 0), 0.5: RGB(237, 237, 0), 1: RGB(30, 0, 255)])

gradient_2 = Gradient(
    LowerLimit="-1",
    UpperLimit="1",
    Parameter=eend.values,
    stops=[0.312: RGB(30, 0, 255), 0.5: RGB(237, 237, 0), 1: RGB(255, 0, 0)])

item_2 = ListItem(List=filterdates.layers, Index=mindex.Index, Wrap=True)
disc_4 = Discontinuity(Curve=crv_4, Level=1)  # -> flatten(Points), Parameters
item_3 = ListItem(List=item_2, Index=0, Wrap=True)  # -> flatten(Item)

demesh = DeconstructMesh(Mesh=mplane.Mesh)  # -> Vertices, Faces, Colours, Normals
conmesh = ConstructMesh(Vertices=demesh.Vertices, Faces=demesh.Faces, Colours=item)

demesh_2 = DeconstructMesh(Mesh=mplane_2.Mesh)  # -> Vertices, Faces, Colours, Normals
conmesh_2 = ConstructMesh(Vertices=demesh_2.Vertices, Faces=demesh_2.Faces, Colours=gradient_2)

demesh_3 = DeconstructMesh(Mesh=mplane_3.Mesh)  # -> Vertices, Faces, Colours, Normals
conmesh_3 = ConstructMesh(Vertices=demesh_3.Vertices, Faces=demesh_3.Faces, Colours=gradient)

# ----
# eeImage
eeimage_2 = Python3Script(layer=item_3, bands="LST_Day_1km", scale=Slider(500, range=0..1000), pts=disc_4.Points)  # -> values, W, H; inputs layer: String, bands: String, mode: String, scale: Int32, pts: list of Point3d; same code as eeimage

py3_5 = Python3Script(pts=disc_4.Points, xyz=Toggle(True))  # -> proj; inputs pts: list of Point3d, xyz: Boolean; same code as py3_2
pline_4 = PolyLine(Vertices=reverse(py3_5), Closed=invert(False))
mplane_4 = MeshPlane(Boundary=pline_4, WidthCount=eeimage_2.W, HeightCount=eeimage_2.H)  # -> Mesh, Area

flip = FlipMatrix(Data=eeimage_2.values)
avr = Average(Input=flip)  # -> flatten(ArithmeticMean)

item_4 = ListItem(List=mplane_4.Mesh, Index=0, Wrap=True)
crv_5 = Curve(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)

bnd_2 = Bounds(Numbers=avr)
dedomain_2 = DeconstructDomain(Domain=bnd_2)  # -> Start, End
gradient_3 = Gradient(
    LowerLimit=dedomain_2.End,
    UpperLimit=dedomain_2.Start,
    Parameter=avr,
    stops=[0: RGB(234, 38, 0), 0.25: RGB(234, 126, 0), 0.5: RGB(254, 244, 84), 0.75: RGB(173, 203, 249), 1: RGB(75, 107, 169)])

demesh_4 = DeconstructMesh(Mesh=item_4)  # -> Vertices, Faces, Colours, Normals
conmesh_4 = ConstructMesh(Vertices=demesh_4.Vertices, Faces=demesh_4.Faces, Colours=gradient_3)

disc_5 = Discontinuity(Curve=crv_5, Level=1)  # -> Points, Parameters
# eeImage
eeimage_3 = Python3Script(layer="NASA/NASADEM_HGT/001", bands="elevation", mode="mean", scale=Slider(100, range=0..1000), pts=disc_5.Points)  # -> values, W, H; inputs layer: String, bands: String, mode: String, scale: Int32, pts: list of Point3d; same code as eeimage

py3_6 = Python3Script(pts=disc_5.Points, xyz=Toggle(True))  # -> proj; inputs pts: list of Point3d, xyz: Boolean; same code as py3_2
pline_5 = PolyLine(Vertices=reverse(py3_6), Closed=invert(False))
mplane_5 = MeshPlane(Boundary=pline_5, WidthCount=eeimage_3.W, HeightCount=eeimage_3.H)  # -> Mesh, Area

bnd_3 = Bounds(Numbers=eeimage_3.values)
dedomain_3 = DeconstructDomain(Domain=bnd_3)  # -> Start, End
gradient_4 = Gradient(
    LowerLimit=dedomain_3.Start,
    UpperLimit=dedomain_3.End,
    Parameter=eeimage_3.values,
    stops=[0: RGB(255, 255, 255), 1: RGB(0, 0, 0)])

demesh_5 = DeconstructMesh(Mesh=mplane_5.Mesh)  # -> Vertices, Faces, Colours, Normals

# ----
# displace with values
Z = UnitZ(Factor=eeimage_3.values)
move = Move(Geometry=demesh_5.Vertices, Motion=Z)  # -> Geometry, Transform

conmesh_5 = ConstructMesh(Vertices=move.Geometry, Faces=demesh_5.Faces, Colours=gradient_4)
